# Dynamo custom node ListBoolReplaceFromStack.dyf "List.BoolReplaceFromStack" (Dynamo 2.5.0.7460)
# category: Gorkys Custom Nodes
# Replaces values at indices of True with items from the stack

list = Input(list: var[]..[])  # Original list
mask = Input(mask: var[]..[])  # Replacement mask
stack = Input(stack: var[]..[])  # Replacement items
python_script = Python(IN[0]=list, IN[1]=mask, IN[2]=stack)
# ---------- python_script.python (29 lines) ----------
# Created by Krzysztof Gorczakowski, 2020
# https://github.com/gorczakowski

def toList(obj):
	if isinstance(obj, list):
		return obj
	else:
		return [obj]

def trypop(lst, alt_item):
	try:
		return lst.pop(0)
	except:
		return alt_item
	
def tryindex(lst, index):
	try:
		return lst[index]
	except:
		return False

lst = toList(IN[0])
mask = toList(IN[1])
stack = toList(IN[2])

try:
	OUT = [trypop(stack, lst[i]) if tryindex(mask, i) else lst[i] for i in range(len(lst))]
except Exception as e:
	OUT = str(e)
# ----------------------------------------
list_2 = Output(python_script)  # "list"; List with replaced items
